# Grasshopper definition drawNautilus.gh (Grasshopper 1.0.7)

number_slider = Slider(1, range=0..5)
number_slider_2 = Slider(0.5, range=0..0.5)
number_slider_3 = Slider(80, range=0..100)
number_slider_4 = Slider(1.6, range=0..30)
number_slider_5 = Slider(0.3, range=0..1)
number_slider_6 = Slider(0.08, range=0..0.1)

# ----
# Design is a series of informational operations
panel = Panel("Predict Unprediction")
read_file = ReadFile(File="C:\Zac\19 Github\Notes\MASdfab-Week2\drawNautilus.py", PerLineParse=False)
ghpython_script = GhPythonScript(
    Code=read_file,
    NautilusSize=1,
    PiceSize=0.5,
    PiceNumber=80,
    Sharpness=0.08,
    CircleSize=1.6,
    CircleRotation=0.3,
    InTemp="12")  # -> Out, Circles, Objects, Colours, OutTemp
panel_2 = Panel(ghpython_script.Out)
