# Grasshopper definition Mandelbrot_v3.gh (Grasshopper 1.0.7)

geometry = Geometry([<mesh referenced from the Rhino model> x82])
area = Area(Geometry=geometry)  # -> Area, Centroid
vector_xyz = VectorXYZ(XComponent=0, YComponent=0, ZComponent=0)  # -> Vector, Length
geometry_2 = Geometry(<mesh referenced from the Rhino model>)
number_slider = Slider(10, range=0..10)
number_slider_2 = Slider(10, range=0..10)
move = Move(Geometry=geometry, Motion=expr("-x", area.Centroid))  # -> Geometry, Transform
number_slider_3 = Slider(100, range=0..100)
number_slider_4 = Slider(5, range=0..10)
series = Series(Start=0, Step="0.1", Count="11")
number_slider_5 = Slider(5, range=0..10)
gradient = Gradient(
    LowerLimit=0,
    UpperLimit=1,
    Parameter=series,
    stops=[0: RGB(234, 38, 0), 0.25: RGB(234, 126, 0), 0.5: RGB(254, 244, 84), 0.75: RGB(173, 203, 249), 1: RGB(75, 107, 169)])
gradient_2 = Gradient(
    LowerLimit=0,
    UpperLimit=1,
    Parameter=series,
    stops=[0: RGBA(0, 0, 0, 0), 0.25: RGB(129, 143, 70), 0.5: RGB(128, 85, 58), 0.75: RGB(173, 203, 249), 1: RGB(176, 181, 197)])
gradient_3 = Gradient(LowerLimit=0, UpperLimit=1, Parameter=series, stops=[0: RGB(255, 255, 255), 1: RGB(0, 0, 0)])
gradient_4 = Gradient(
    LowerLimit=0,
    UpperLimit=1,
    Parameter=series,
    stops=[0: RGB(0, 98, 0), 0.25: RGB(81, 175, 17), 0.5: RGB(159, 198, 146), 0.75: RGB(170, 235, 41), 1: RGB(221, 255, 53)])
read_file = ReadFile(File="C:\Zac\19 Github\Notes\MASdfab-Week5\Mandelbrot_v3.py", PerLineParse=False)
ghpython_script = GhPythonScript(
    Code=read_file,
    XRoughness=number_slider_3,
    YRoughness=number_slider_3,
    ZRoughness=number_slider_3,
    Colors=reverse(gradient_3))  # -> Out, OutTemp, X
number = Number(ghpython_script.OutTemp)
mesh = Mesh(ghpython_script.OutTemp)
move_2 = Move(Geometry=ghpython_script.OutTemp, Motion=area.Centroid)  # -> Geometry, Transform
panel = Panel(ghpython_script.Out)
panel_2 = Panel(ghpython_script.OutTemp)
